# Grasshopper definition gimbal_test_4.gh (Grasshopper 1.0.7)

x_rotation = Slider(0, range=-30..30)
# Final simulation of Thrust Vector Control
# Controller
motor_holder_r = Slider(15, range=0..100)
inner_gimbal_r = Slider(25, range=0..100)
outer_gimbal_r = Slider(35, range=0..100)
_1_2_height = Slider(35, range=0..100)
y_rotation = Slider(0, range=-30..30)

cir = Circle(Plane=PlaneXY(0, 0, 0), Radius=motor_holder_r)

# ---- group: extruding_motor
eval = Evaluate(F="x*-1", x=_1_2_height)
Z = UnitZ(Factor=[eval, _1_2_height])
extr = Extrude(Base=cir, Direction=Z)

# ----
X = UnitX(Factor=1)
cir_2 = Circle(Plane=PlaneXY(0, 0, 0), Radius=inner_gimbal_r)

# ---- group: outer_gimbal
cir_3 = Circle(Plane=PlaneXY(0, 0, 0), Radius=outer_gimbal_r)

# ---- group: creating_perpendicular_rotation_axis
curvepoint = PointOnCurve(cir, parameter=0.25)
pt = ConstructPoint(XCoordinate=0, YCoordinate=0, ZCoordinate=0)
ln = Line(StartPoint=curvepoint, EndPoint=pt)

# ----
Z_2 = UnitZ(Factor=_1_2_height)

# ---- group: inner_gimbal_initial
rot3d = Rotate3D(Geometry=cir_2, Angle=degrees("0"), Center=Point(0, 0, 0), Axis=X)  # -> Geometry, Transform

# ----
rot3d_2 = Rotate3D(Geometry=[cir, extr, ln], Angle=degrees(x_rotation), Center=Point(0, 0, 0), Axis=X)  # -> Geometry, Transform
curvepoint_2 = PointOnCurve(rot3d.Geometry, parameter=0)
split = SplitList(List=rot3d_2.Geometry, Index="3")  # -> ListA, ListB
move = Move(Geometry=curvepoint_2, Motion=expr("-x", Z_2))  # -> Geometry, Transform

# ---- group: measuring_lenths
Y = UnitY(Factor=1)
move_2 = Move(Geometry=cir_3, Motion=expr("-x", Z_2))  # -> Geometry, Transform
line = LineSDL(Start=move.Geometry, Direction=Y, Length=outer_gimbal_r)
ccx = CurveCurve(CurveA=line, CurveB=move_2.Geometry)  # -> Points, ParamsA, ParamsB
Z_3 = UnitZ(Factor=1)

# ---- group: created_rotation_axis
geo = Geometry(split.ListB)

# ----
ln_2 = Line(StartPoint=curvepoint_2, EndPoint=move.Geometry)

# ---- group: motor_holder
rot3d_3 = Rotate3D(Geometry=split.ListA, Angle=degrees(y_rotation), Center=Point(0, 0, 0), Axis=geo)  # -> Geometry, Transform

# ----
join = JoinCurves(Curves=[ln_2, rot3d.Geometry], Preserve=False)
debrep = DeconstructBrep(Brep=rot3d_3.Geometry)  # -> Faces, flatten(Edges), flatten(Vertices)
geo_2 = Geometry(debrep.Vertices)

# ---- group: measuring_lenths / vertical_length
line_2 = LineSDL(Start=ccx.Points, Direction=Z_3, Length=_1_2_height)

# ---- group: measuring_lenths / horizontal_length
ln_3 = Line(StartPoint=move.Geometry, EndPoint=ccx.Points)

# ----
split_2 = SplitList(List=geo_2, Index="4")  # -> ListA, ListB

# ---- group: inner_gimbal_&_arm
rot3d_4 = Rotate3D(Geometry=join, Angle=degrees(x_rotation), Center=Point(0, 0, 0), Axis=X)  # -> flatten(Geometry), Transform

# ---- group: top_motor_point
pt_2 = Point(split_2.ListB)

# ----
split_3 = SplitList(List=rot3d_4.Geometry, Index="1")  # -> ListA, ListB

# ---- group: inner_gimbal
geo_3 = Geometry(split_3.ListA)

# ---- group: measuring_tangent_length
curvepoint_3 = PointOnCurve(cir, parameter=0)
X_2 = UnitX(Factor=1)
line_3 = LineSDL(Start=curvepoint_3, Direction=X_2, Length=inner_gimbal_r)
ccx_2 = CurveCurve(CurveA=line_3, CurveB=geo_3)  # -> Points, ParamsA, ParamsB
ln_4 = Line(StartPoint=curvepoint_3, EndPoint=ccx_2.Points)

# ---- group: arm
geo_4 = Geometry(split_3.ListB)

# ----
curvepoint_4 = PointOnCurve(geo_3, parameter=0)

curvepoint_5 = PointOnCurve(geo_4, parameter=1)
# JOINT: Outer to inner gimbal
curvepoint_6 = PointOnCurve(line_2, parameter=1)
yz = YZPlane(Origin=curvepoint_5)
yz_2 = YZPlane(Origin=curvepoint_6)
cir_4 = Circle(Plane=yz, Radius=ln_3)
cir_5 = Circle(Plane=yz_2, Radius=line_2)
ccx_3 = CurveCurve(CurveA=cir_4, CurveB=cir_5)  # -> Points, ParamsA, ParamsB
pdecon = Deconstruct(Point=ccx_3.Points)  # -> XComponent, YComponent, ZComponent
sort = SortList(Keys=pdecon.ZComponent, ValuesA=ccx_3.Points)  # -> Keys, ValuesA
item = ListItem(List=sort.ValuesA, Index=0, Wrap=True)  # -> Item, Item1, Item2, Item3, Item4
ln_5 = Line(StartPoint=curvepoint_6, EndPoint=item.Item)
ln_6 = Line(StartPoint=item.Item, EndPoint=curvepoint_5)

X_3 = UnitX(Factor=1)

xz = XZPlane(Origin=pt_2)
xz_2 = XZPlane(Origin=ccx_2.Points)
# JOINT: Inner to motor holder
cir_6 = Circle(Plane=xz, Radius=ln_4)
cir_7 = Circle(Plane=xz_2, Radius=_1_2_height)
rot3d_5 = Rotate3D(Geometry=cir_6, Angle=degrees(x_rotation), Center=pt_2, Axis=X_3)  # -> Geometry, Transform
rot3d_6 = Rotate3D(Geometry=cir_7, Angle=degrees(x_rotation), Center=ccx_2.Points, Axis=X_3)  # -> Geometry, Transform
ccx_4 = CurveCurve(CurveA=rot3d_5.Geometry, CurveB=rot3d_6.Geometry)  # -> flatten(Points), ParamsA, ParamsB
pdecon_2 = Deconstruct(Point=ccx_4.Points)  # -> XComponent, YComponent, ZComponent
sort_2 = SortList(Keys=pdecon_2.ZComponent, ValuesA=ccx_4.Points)  # -> Keys, ValuesA
item_2 = ListItem(List=sort_2.ValuesA, Index=0, Wrap=True)  # -> Item, Item1
ln_7 = Line(StartPoint=xz, EndPoint=item_2.Item1)
ln_8 = Line(StartPoint=item_2.Item1, EndPoint=curvepoint_4)

# ---- group: upper_joint
join_2 = JoinCurves(Curves=[ln_8, ln_7], Preserve=False)

# ---- group: lower_joint
join_3 = JoinCurves(Curves=[ln_5, ln_6], Preserve=False)

# ----
crv = Curve(join_2)
crv_2 = Curve(join_3)

number_slider = Slider(0.04, range=0..1)
explode = Explode(Curve=[crv_2, geo_4, crv], Recursive=True)  # -> Segments, Vertices
flip = FlipCurve(Curve=explode.Segments)  # -> Curve, Flag
# Pipes
eval_2 = EvaluateLength(Curve=explode.Segments, Length=number_slider, Normalized=True)  # -> Point, Tangent, Parameter
eval_3 = EvaluateLength(Curve=flip.Curve, Length=number_slider, Normalized=True)  # -> Point, Tangent, Parameter
ln_9 = Line(StartPoint=eval_2.Point, EndPoint=eval_3.Point)
pt_3 = Point(explode.Vertices)
pipe = Pipe(Curve=ln_9, Radius=1, Caps=0)
msphere = MeshSphere(Base=pt_3, Radius=Slider(1.84, range=0..10), UCount=10, VCount=20)
pipe_2 = Pipe(Curve=[geo_3, cir_3], Radius=1, Caps=0)

# ----
# Color
swatch = ColourSwatch(SwatchColor=RGBA(0, 255, 0, 175))
preview = CustomPreview(Geometry=pipe, Material=swatch)
preview_2 = CustomPreview(Geometry=msphere, Material=ColourSwatch(SwatchColor=RGBA(0, 0, 0, 175)))
preview_3 = CustomPreview(Geometry=pipe_2, Material=ColourSwatch(SwatchColor=RGB(255, 0, 0)))
preview_4 = CustomPreview(Geometry=rot3d_3.Geometry, Material=ColourSwatch(SwatchColor=RGB(255, 249, 255)))
