# Grasshopper definition logic_of_gimbal.gh (Grasshopper 1.0.7)

# ---- group: controls
number_slider = Slider(4.52, range=-30..30)
number_slider_2 = Slider(10.8, range=0..50)
number_slider_3 = Slider(12.99, range=-30..30)
number_slider_4 = Slider(23.04, range=0..50)

# ---- group: rotation_of_two_circles
outer_r = Slider(26.35, range=0..100)
y_rotation = Slider(17.51, range=-30..30)
inner_r = Slider(16.94, range=0..100)
x_rotation = Slider(0, range=-30..30)
cir = Circle(Plane=PlaneXY(0, 0, 0), Radius=outer_r)
cir_2 = Circle(Plane=PlaneXY(0, 0, 0), Radius=inner_r)
Y = UnitY(Factor=1)
rot3d = Rotate3D(Geometry=[cir, cir_2], Angle=degrees(y_rotation), Center=Point(0, 0, 0), Axis=Y)  # -> Geometry, Transform
split = SplitList(List=rot3d.Geometry, Index=Slider(1, range=0..10))  # -> ListA, ListB
X = UnitX(Factor=1)
geo = Geometry(split.ListB)
rot3d_2 = Rotate3D(Geometry=geo, Angle=degrees(x_rotation), Center=Point(0, 0, 0), Axis=X)  # -> Geometry, Transform

# ---- group: basic_rotation_of_one_circle
# This script step-by-step demonstrates the logic in designing a gimbal.
# The final output is the third script tagged "true_rotation_of_two_circles".
number_slider_5 = Slider(25.32, range=0..100)
x_rotation_2 = Slider(0, range=-30..30)
y_rotation_2 = Slider(0, range=-30..30)
cir_3 = Circle(Plane=PlaneXY(0, 0, 0), Radius=number_slider_5)
X_2 = UnitX(Factor=1)
Y_2 = UnitY(Factor=1)
rot3d_3 = Rotate3D(Geometry=cir_3, Angle=degrees(x_rotation_2), Center=Point(0, 0, 0), Axis=X_2)  # -> Geometry, Transform
rot3d_4 = Rotate3D(Geometry=rot3d_3.Geometry, Angle=degrees(y_rotation_2), Center=Point(0, 0, 0), Axis=Y_2)  # -> Geometry, Transform
pipe = Pipe(Curve=rot3d_4.Geometry, Radius=1, Caps=0)

# ---- group: true_rotation_of_two_circles
inner_r_2 = Slider(25, range=0..100)
outer_r_2 = Slider(40, range=0..100)
x_rotation_3 = Slider(0, range=-30..30)
y_rotation_3 = Slider(0, range=-30..30)
cir_4 = Circle(Plane=PlaneXY(0, 0, 0), Radius=inner_r_2)
cir_5 = Circle(Plane=PlaneXY(0, 0, 0), Radius=outer_r_2)
X_3 = UnitX(Factor=1)
Y_3 = UnitY(Factor=1)
rot3d_5 = Rotate3D(Geometry=cir_4, Angle=degrees(x_rotation_3), Center=Point(0, 0, 0), Axis=X_3)  # -> Geometry, Transform
rot3d_6 = Rotate3D(Geometry=cir_5, Angle=degrees(x_rotation_3), Center=Point(0, 0, 0), Axis=X_3)  # -> Geometry, Transform
rot3d_7 = Rotate3D(Geometry=rot3d_5.Geometry, Angle=degrees(y_rotation_3), Center=Point(0, 0, 0), Axis=Y_3)  # -> Geometry, Transform
pipe_2 = Pipe(Curve=[rot3d_7.Geometry, rot3d_6.Geometry], Radius=1, Caps=0)

# ---- group: rings
cir_6 = Circle(Plane=PlaneXY(0, 0, 0), Radius=number_slider_2)
cir_7 = Circle(Plane=PlaneXY(0, 0, 0), Radius=number_slider_4)
X_4 = UnitX(Factor=1)
rot3d_8 = Rotate3D(Geometry=cir_6, Angle=degrees(number_slider_3), Center=Point(0, 0, 0), Axis=X_4)  # -> Geometry, Transform
rot3d_9 = Rotate3D(Geometry=cir_7, Angle=degrees(number_slider_3), Center=Point(0, 0, 0), Axis=X_4)  # -> Geometry, Transform
Y_4 = UnitY(Factor=1)
rot3d_10 = Rotate3D(Geometry=rot3d_8.Geometry, Angle=degrees(number_slider), Center=Point(0, 0, 0), Axis=Y_4)  # -> Geometry, Transform

# ----
pipe_3 = Pipe(Curve=[rot3d_10.Geometry, rot3d_9.Geometry], Radius=1, Caps=0)
